# Grasshopper definition read_analog.ghx (Grasshopper 1.0.7)
# plug-ins: Firefly.Core

python = GhPythonScript(send=Button(), val=Slider(1.2, range=1.1..2.1))  # -> out, script; inputs send: Boolean
# ---------- python: Python ----------
import sys
path = "C:/Users/ananya/Documents/masdfab-notes/work/T1-GKR/tutorials"
if path not in sys.path:
    sys.path.append(path)
    
import imp

import Rhino.Geometry as rg
import simple_comm as c
import simple_ur_script as ur
import math as m
import ghpythonlib.components as ghc


imp.reload(ur)
imp.reload(c)

def set_aspeed(speed):
    if speed<1.1:
        speed = 1.1
    if speed>2.1:
        speed = 2.1
    val = ghc.RemapNumbers(speed,ghc.ConstructDomain(1.1,2.1),ghc.ConstructDomain(0,0.5))
    f = val['mapped']
    script = ur.set_analog_out(0,f)
    return script

script = ""

script += set_aspeed(val)

script = c.concatenate_script(script)
if send:
    c.send_script(script, "192.168.10.10")
# ---------- end python ----------
toggle = BooleanToggle(False)
open_port = OpenClosePort(OpenClosePort=toggle, PortNumber="3", BaudRate="115200")
write = SerialWriteGeneric(StartWritingValues=Toggle(False), WriteData="stat", PortNumber="3")  # -> ArduinoOutput, StatusMessage
read = SerialReadGeneric(StartReadingValues=toggle, PortNumber="3")  # -> SerialOutput, StatusMessage
panel = Panel(python.script)
trigger = Trigger(Interval=100, TimerInterval=100, Target=[write, read])  # disabled
panel_2 = Panel(read.SerialOutput)
